# Grasshopper definition 1_PartA_Level3_03_Final案例深化.gh (Grasshopper 1.0.7)
# plug-ins: ChopChop, Bifocals

# ---- group: Rhino曲线
line = Line(Line((1.607543357, 0.7472993959, 0), (3.744232981, 4.536981527, 0)))

# ---- group: Frame（网架）
square = Square(Plane=PlaneXY(0, 0, 0), Size=1, ExtentX=5, ExtentY=5)  # -> Cells, Points
curve = Curve(square.Cells)

# ----
chopchop = ChopChop()
evaluate_curve = EvaluateCurve(Curve=reparameterize(line), Parameter=Slider(1, range=0..1))  # -> Point, Tangent, Angle
area = Area(Geometry=curve)  # -> Area, Centroid
pull_point = PullPoint(Point=area.Centroid, Geometry=evaluate_curve.Point, ClosestOnly=True)  # -> ClosestPoint, Distance
bounds = Bounds(Numbers=pull_point.Distance)
graph_mapper = GraphMapper(
    pull_point.Distance,
    x0=0,
    x1=10,
    y0=0,
    y1=10,
    container_name="Bezier",
    cpx=[0, 0.5360191464, 0.3449950218, 1],
    cpy=[0, 0.3680282831, 0.697119236, 1])
curve_2 = Curve(curve)
remap_numbers = RemapNumbers(Value=graph_mapper, Source=bounds, Target="0.1 to 0.9")  # -> Mapped, Clipped
deconstruct_brep = DeconstructBrep(Brep=curve_2)  # -> Faces, Edges, Vertices
graft_tree = GraftTree(Tree=flatten(remap_numbers.Mapped), IncludeEmptyLists=True, IncludeNullItems=True)
area_2 = Area(Geometry=deconstruct_brep.Faces)  # -> Area, Centroid
point_on_curve = PointOnCurve(deconstruct_brep.Edges, parameter=0.51)
line_2 = Line(StartPoint=area_2.Centroid, EndPoint=point_on_curve)
unit_z = UnitZ(Factor=graft_tree)
evaluate_curve_2 = EvaluateCurve(Curve=reparameterize(line_2), Parameter=graft_tree)  # -> Point, Tangent, Angle
end_points = EndPoints(Curve=deconstruct_brep.Edges)  # -> Start, End
graft_tree_2 = GraftTree(Tree=end_points.Start, IncludeEmptyLists=True, IncludeNullItems=True)
graft_tree_3 = GraftTree(Tree=end_points.End, IncludeEmptyLists=True, IncludeNullItems=True)
move = Move(Geometry=evaluate_curve_2.Point, Motion=unit_z)  # -> Geometry, Transform
graft_tree_4 = GraftTree(Tree=move.Geometry, IncludeEmptyLists=True, IncludeNullItems=True)
merge = Merge(Data1=graft_tree_4, Data2=graft_tree_2, Data3=graft_tree_3)
nurbs_curve = NurbsCurve(Vertices=merge, Degree=3, Periodic=False)  # -> Curve, Length, Domain
path_mapper = PathMapper(nurbs_curve.Curve, source="{A;B;C}", target="{A;B}")
loft = Loft(Curves=path_mapper, Options={Adjust=False, Closed=False, LoftEnds=0, LoftSimp=0, LoftType=0, Rebuild=10, Refit=0.01})
