# Grasshopper definition 1_PartA_Level3_03_Graph Mappe控制单元变化.gh (Grasshopper 1.0.7)
# plug-ins: ChopChop, Bifocals

line = Line(Line((1.607543357, 0.7472993959, 0), (3.744232981, 4.536981527, 0)))
evaluate_curve = EvaluateCurve(Curve=reparameterize(line), Parameter=Slider(1, range=0..1))  # -> Point, Tangent, Angle

square = Square(Plane=PlaneXY(0, 0, 0), Size=1, ExtentX=5, ExtentY=5)  # -> Cells, Points
curve = Curve(square.Cells)

chopchop = ChopChop()
area = Area(Geometry=curve)  # -> Area, Centroid
pull_point = PullPoint(Point=area.Centroid, Geometry=evaluate_curve.Point, ClosestOnly=True)  # -> ClosestPoint, Distance
bounds = Bounds(Numbers=pull_point.Distance)
graph_mapper = GraphMapper(
    pull_point.Distance,
    x0=0,
    x1=10,
    y0=0,
    y1=10,
    container_name="Bezier",
    cpx=[0, 0.7669832706, 0.4400550723, 1],
    cpy=[0, 0.2918028831, 0.6204572916, 1])
curve_2 = Curve(curve)
remap_numbers = RemapNumbers(Value=graph_mapper, Source=bounds, Target="0.1 to 0.9")  # -> Mapped, Clipped
deconstruct_brep = DeconstructBrep(Brep=curve_2)  # -> Faces, Edges, Vertices
graft_tree = GraftTree(Tree=flatten(remap_numbers.Mapped), IncludeEmptyLists=True, IncludeNullItems=True)
area_2 = Area(Geometry=deconstruct_brep.Faces)  # -> Area, Centroid
number = Number(graft_tree)
evaluate_curve_2 = EvaluateCurve(Curve=reparameterize(deconstruct_brep.Edges), Parameter=number)  # -> Point, Tangent, Angle
line_2 = Line(StartPoint=area_2.Centroid, EndPoint=evaluate_curve_2.Point)
