# Grasshopper definition 1_PartA_Level3_all in one_NEW0210.gh (Grasshopper 1.0.7)
# plug-ins: ChopChop, Bifocals

# ---- group: Frame框架
# All in one
number_slider = Slider(3, range=0..100)
square = Square(Plane=PlaneXY(0, 0, 0), Size=1, ExtentX=number_slider, ExtentY=Slider(4, range=0..100))  # -> flatten(Cells), Points
curve = Curve(square.Cells)

# ---- group: 输入直线上一个滑动的点
line = Line(Line((0.4278359398, -0.8011521727, 0), (5.25555289, 6.262333181, 0)))
evaluate_curve = EvaluateCurve(Curve=reparameterize(line), Parameter=Slider(0.425, range=0..1))  # -> Point, Tangent, Angle

# ----
line_2 = Line(Line((-0.2356079283, 0.3692247663, 0), (1.373184055, 5.195600715, 0)))

# ---- group: 输入两条曲线作为控制线
curve_2 = Curve([line, line_2])

# ----
chopchop = ChopChop()
area = Area(Geometry=curve)  # -> Area, Centroid
area_2 = Area(Geometry=curve)  # -> Area, Centroid
pull_point = PullPoint(Point=area_2.Centroid, Geometry=[curve_2, evaluate_curve.Point], ClosestOnly=True)  # -> ClosestPoint, Distance
bounds = Bounds(Numbers=pull_point.Distance)
panel = Panel(pull_point.Distance)
graph_mapper = GraphMapper(
    pull_point.Distance,
    x0=0,
    x1=10,
    y0=0,
    y1=10,
    container_name="Bezier",
    cpx=[0, 0.2972818911, 0.8269918561, 1],
    cpy=[0, 0.567391634, 0.3240944743, 1])
remap_numbers = RemapNumbers(Value=[graph_mapper, pull_point.Distance], Source=bounds, Target="0.1 to 0.9")  # -> Mapped, Clipped
chopchop_2 = ChopChop()
panel_2 = Panel(remap_numbers.Mapped)
graft_tree = GraftTree(Tree=flatten(remap_numbers.Mapped), IncludeEmptyLists=True, IncludeNullItems=True)

relay = Relay()  # disabled
number = Number(relay)

curve_3 = Curve()
deconstruct_brep = DeconstructBrep(Brep=curve_3)  # -> Faces, Edges, Vertices
area_3 = Area(Geometry=deconstruct_brep.Faces)  # -> Area, Centroid
evaluate_curve_2 = EvaluateCurve(Curve=reparameterize(deconstruct_brep.Edges), Parameter=number)  # -> Point, Tangent, Angle
line_3 = Line(StartPoint=area_3.Centroid, EndPoint=evaluate_curve_2.Point)

panel_3 = Panel(graft_tree)
area_4 = Area(Geometry=deconstruct_brep.Faces)  # -> Area, Centroid
curve_4 = Curve(curve)
deconstruct_brep_2 = DeconstructBrep(Brep=curve_4)  # -> Faces, Edges, Vertices
area_5 = Area(Geometry=deconstruct_brep_2.Faces)  # -> Area, Centroid
point_on_curve = PointOnCurve(deconstruct_brep_2.Edges, parameter=0.552)
line_4 = Line(StartPoint=area_5.Centroid, EndPoint=point_on_curve)
end_points = EndPoints(Curve=deconstruct_brep_2.Edges)  # -> Start, End
evaluate_curve_3 = EvaluateCurve(Curve=line_4, Parameter=graft_tree)  # -> Point, Tangent, Angle
unit_z = UnitZ(Factor=graft_tree)
move = Move(Geometry=evaluate_curve_3.Point, Motion=unit_z)  # -> Geometry, Transform

graft_tree_2 = GraftTree(Tree=move.Geometry, IncludeEmptyLists=True, IncludeNullItems=True)
graft_tree_3 = GraftTree(Tree=end_points.Start, IncludeEmptyLists=True, IncludeNullItems=True)
graft_tree_4 = GraftTree(Tree=end_points.End, IncludeEmptyLists=True, IncludeNullItems=True)

merge = Merge(Data1=graft_tree_2, Data2=graft_tree_3, Data3=graft_tree_4)
nurbs_curve = NurbsCurve(Vertices=merge, Degree="2", Periodic=False)  # -> Curve, Length, Domain
path_mapper = PathMapper(nurbs_curve.Curve, source="{A;B;C}", target="{A;B}")
loft = Loft(Curves=path_mapper, Options={Adjust=False, Closed=True, LoftEnds=0, LoftSimp=0, LoftType=3, Rebuild=10, Refit=0.01})
