# Grasshopper definition 3_PartC_Level1_03_曲面形成.gh (Grasshopper 1.0.7)

# ----
# 曲面形成
crv = Curve(<curve referenced from the Rhino model>)
divide = DivideCurve(Curve=crv, Count="100", Kinks=False)  # -> Points, Tangents, Parameters
series = Series(Start=0, Step=1, Count="100")
graph = GraphMapper(series, x0=0, x1=100, y0=0, y1=10, container_name="Gaussian", factor=0.1297100782, mean=0.4902175665, sdev=0.08306995034)
shift = ShiftList(List=divide.Points, Shift=Slider(72, range=0..100), Wrap=True)
Z = UnitZ(Factor=graph)
move = Move(Geometry=shift, Motion=Z)  # -> Geometry, Transform

crv_2 = Curve(<curve referenced from the Rhino model>)
divide_2 = DivideCurve(Curve=crv_2, Count="100", Kinks=False)  # -> Points, Tangents, Parameters
series_2 = Series(Start=0, Step=1, Count="100")
graph_2 = GraphMapper(
    series_2,
    x0=0,
    x1=100,
    y0=0,
    y1=15,
    container_name="Gaussian",
    factor=0.2679801583,
    mean=0.5144348145,
    sdev=0.2314094901)
shift_2 = ShiftList(List=divide_2.Points, Shift=Slider(65, range=0..100), Wrap=True)
Z_2 = UnitZ(Factor=graph_2)
move_2 = Move(Geometry=shift_2, Motion=Z_2)  # -> Geometry, Transform

intcrv = Interpolate(Vertices=move_2.Geometry, Degree=3, Periodic=True, KnotStyle=1)  # -> Curve, Length, Domain
intcrv_2 = Interpolate(Vertices=move.Geometry, Degree=3, Periodic=True, KnotStyle=1)  # -> Curve, Length, Domain
loft = Loft(
    Curves=[intcrv_2.Curve, intcrv.Curve],
    Options={Adjust=False, Closed=False, LoftEnds=0, LoftSimp=0, LoftType=0, Rebuild=10, Refit=0.01})

pdecon = Deconstruct(Point=move.Geometry)  # -> XComponent, YComponent, ZComponent
bnd = Bounds(Numbers=pdecon.ZComponent)
dedomain = DeconstructDomain(Domain=bnd)  # -> Start, End
参数反馈显示 = Panel(dedomain.End)
